# Grasshopper definition CurveCompressor.gh (Grasshopper 1.0.7)

surface = Surface(<surface referenced from the Rhino model>)
curve = Curve(<curve referenced from the Rhino model>)
script_1_tbd = GhPythonScript(x=surface, y=curve)  # -> out, a
# ---------- script_1_tbd: Python ----------
__author__ = "Shoon"
__version__ = "2020.11.04"

import rhinoscriptsyntax as rs


# Read points along curve
points = rs.CurvePoints(y)

# Compute tangent vectors to curve at each point

# Compute normal vectors to surface at each point
# Compute the cross product of the above two vectors at each point
# Displace points along said cross product by some distance
# Copy points up by epsilon and down by epsilon to form a ribbon
# Take the intersection of the ribbon with the surface and draw it
# ---------- end script_1_tbd ----------
