# Grasshopper definition S20.gh (Grasshopper 1.0.7)

construct_domain = ConstructDomain(DomainStart=0, DomainEnd=1)
integer = Integer(8)
range = Range(Domain=construct_domain, Steps=integer)
curve = Curve(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)
evaluate_curve = EvaluateCurve(Curve=reparameterize(curve), Parameter=range)  # -> Point, Tangent, Angle
raw_puncture_curves = Curve([<curve referenced from the Rhino model> x8])
raw_map_curves = Curve([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])
curve_2 = Curve(<curve referenced from the Rhino model>)
wide = Slider(0.341, range=-10..10)
taper = Slider(0.047, range=-0.2..0.2)
explode = Explode(Curve=curve_2, Recursive=True)  # -> Segments, Vertices
genus_2_surface = Genus2Surface(wide=wide, long=Slider(2.73, range=0..5), round=Slider(5.379, range=0..10), thick=Slider(9, range=0..10), taper=taper)  # -> L, geo_2
cluster = Cluster(curve=raw_puncture_curves, brep=genus_2_surface.geo_2)
cluster_2 = Cluster(curve=raw_map_curves, brep=genus_2_surface.geo_2)
number = Number(300)
number_2 = Number(30)
opacity = Slider(128, range=0..255)
color = Slider(16, range=0..19)
surface_closest_point = SurfaceClosestPoint(Point=explode.Vertices, Surface=genus_2_surface.L)  # -> Point, UVPoint, Distance
puncture_curves_on_polysurface = Curve(reparameterize(cluster))
map_curves_on_polysurface = Curve(reparameterize(cluster_2))
range_2 = Range(Domain=Domain(0, 1), Steps=number)
range_3 = Range(Domain=Domain(0, 1), Steps=number_2)
point = Point(surface_closest_point.Point)
mypreview = RGBPreview(G=genus_2_surface.geo_2, A=opacity, N=color)
curve_on_surface = CurveOnSurface(Surface=genus_2_surface.L, UVCoordinates=surface_closest_point.UVPoint, Closed=False)  # -> Curve, Length, Domain
evaluate_curve_2 = EvaluateCurve(Curve=puncture_curves_on_polysurface, Parameter=range_3)  # -> Point, Tangent, Angle
evaluate_curve_3 = EvaluateCurve(Curve=map_curves_on_polysurface, Parameter=range_2)  # -> Point, Tangent, Angle
ghpython_script = GhPythonScript(mapCurves=map_curves_on_polysurface, punctureCurves=puncture_curves_on_polysurface)  # -> out, masterCurve
# ---------- ghpython_script: Python ----------
"""Provides a scripting component.
    Inputs:
        mapCurves: The curves representing the sides of the map
        punctureCurves: The curves representing the puncture
    Output:
        masterCurve: This will be the curve that we contract from.
            It can be thought of as tracing the perimeter of our map."""

__author__ = "Shoon"
__version__ = "2020.12.29"

import rhinoscriptsyntax as rs

# For now, we'll join these manually.
# Later it will probably make sense to find a more intelligent way to do this.
# For example, we could find the puncture curve which connects the appropriate endpooints.

m = mapCurves
p = punctureCurves
joinOrder = [] # Specify order manually

# Figure out how to join curves
# mastercurve = rs.JoinCurves([rs.coercecurve(mapCurves,segment_index=0),rs.coercecurve(mapCurves,segment_index=1)])

mastercurve = mapCurves
print(mastercurve)
# ---------- end ghpython_script ----------
polyline = PolyLine(Closed=False)

# ==== cluster RGBPreview: Custom Preview clustered with RGB module with preset colors
N = ClusterInput()
python = GhPythonScript(N=N)  # -> out, R, G, B
# ---------- python: Python ----------
__author__ = "will"
__version__ = "2020.07.20"

import rhinoscriptsyntax as rs

colors=[(0,0,0),(255,255,255),(115,115,115),(255,0,0),(0,255,0),(0,0,255),(255,255,0),(255,0,255),(0,255,255),(0,162,255),(252,124,21),(124,51,202),(23,151,59),(255,80,90),(255,80,226),(32,214,255),(0,92,0),(0,0,120),(112,255,49),(138,78,0)]

N=int(N)
R = colors[N][0]
G = colors[N][1]
B = colors[N][2]
# ---------- end python ----------
A = ClusterInput()
G = ClusterInput()
rgb = ColourRGB(Alpha=A, Red=python.R, Green=python.G, Blue=python.B)
preview = CustomPreview(Geometry=G, Material=rgb)

# ==== cluster Genus2Surface
number_slider = Slider(4, range=0..16)
wide = ClusterInput()
multiplication = Multiplication(A=number_slider, B=2)
long = ClusterInput()
round = ClusterInput()
thick = ClusterInput()
subtraction = Subtraction(A=number_slider, B=1)
taper = ClusterInput()

# ----
# wonky tori
number_slider_2 = Slider(16.8, range=0..20)
addition = Addition(A=number_slider_2, Wide=wide)
dom = ConstructDomain(DomainStart=0, DomainEnd=1)
ellipse = Ellipse(Plane=PlaneXY(0, 0, 0), Radius1=number_slider_2, Radius2=addition)  # -> reparameterize(Ellipse), Focus1, Focus2
range = Range(Domain=dom, Steps=multiplication)
num = Number(range)
curvature = Curvature(Curve=ellipse.Ellipse, Parameter=num)  # -> P, unitize(K), C
python = GhPythonScript(x=num, long=long, round=round, thick=thick)  # -> out, a, b, c
# ---------- python: Python ----------
__author__ = "will"
__version__ = "2020.07.08"

import rhinoscriptsyntax as rs

a = ((x-.5)*long)**6

b = ((x-.5)*round)**2 + thick

c = a + thick
# ---------- end python ----------
rev = Reverse(Vector=curvature.K)
multiplication_2 = Multiplication(A=rev, B=python.a)
number_slider_3 = Slider(12, range=0..30)
addition_2 = Addition(A=multiplication_2, B=curvature.P)
Z = UnitZ(Factor=1)
dom_2 = ConstructDomain(DomainStart=0, DomainEnd=1)
pl = ConstructPlane(Origin=addition_2, XAxis=Z, YAxis=curvature.K)
range_2 = Range(Domain=dom_2, Steps=number_slider_3)
ellipse_2 = Ellipse(Plane=pl, Radius1=python.b, Radius2=python.c)  # -> reparameterize(Ellipse), Focus1, Focus2
split = SplitList(List=range_2, Index=number_slider_3)  # -> graft(ListA), ListB
item = ListItem(List=addition_2, Index=0, Wrap=True)
eval = EvaluateCurve(Curve=ellipse_2.Ellipse, Parameter=split.ListA)  # -> Point, Tangent, Angle
split_2 = SplitList(List=ellipse_2.Ellipse, Index=1)  # -> ListA, ListB
yz = YZPlane(Origin=Point(0, 0, 0))
intcrv = Interpolate(Vertices=eval.Point, Degree=3, Periodic=True, KnotStyle=1)  # -> flatten(Curve), Length, Domain
pl_origin = PlaneOrigin(Base=yz, Origin=item)
number_slider_4 = Slider(0.3, range=0..1)
addition_3 = Addition(A=number_slider_4, Taper=taper)

shift = ShiftList(List=split_2.ListB, Shift=subtraction, Wrap=True)

netsurf = NetworkSurface(CurvesU=shift, CurvesV=intcrv.Curve, Continuity=2)
mirror = Mirror(Geometry=netsurf, Plane=pl_origin)  # -> Geometry, Transform
join = BrepJoin(Breps=[mirror.Geometry, netsurf])  # -> Breps, Closed
taper_2 = Taper(
    Geometry=join.Breps,
    Axis=Line((-30, 0, 0), (80, 0, 0)),
    Start=number_slider_4,
    End=addition_3,
    Flat=False,
    Infinite=False,
    Rigid=False)
item_2 = ListItem(List=taper_2, Index=1, Wrap=True)
item_3 = ListItem(List=taper_2, Index=0, Wrap=True)

# ----
# Waist
hilonums = HighestLowestNumbers(Numbers=python.c)  # -> Highest, Lowest
number_slider_5 = Slider(7.305, range=0..10)
number_slider_6 = Slider(3.563, range=0..4)
number_slider_7 = Slider(2.366, range=0..4)
multiplication_3 = Multiplication(A=hilonums.Highest, B=2)
neg = Negative(Value=number_slider_7)
neg_2 = Negative(Value=number_slider_6)
neg_3 = Negative(Value=number_slider_5)
division = Division(A=hilonums.Highest, B=[neg_3, neg_2, neg])
division_2 = Division(A=hilonums.Highest, B=[number_slider_7, number_slider_6, number_slider_5])
X = UnitX(Factor=division_2)
X_2 = UnitX(Factor=division)
bbox = BoundingBox(Content=taper_2, Plane=PlaneXY(0, 0, 0), UnionBox=True)  # -> Box, Box_2
move = Move(Geometry=pl_origin, Motion=X)  # -> Geometry, Transform
move_2 = Move(Geometry=pl_origin, Motion=X_2)  # -> Geometry, Transform
box_corners = BoxCorners(Box=bbox.Box)  # -> CornerA, CornerB, CornerC, CornerD, CornerE, CornerF, CornerG, CornerH
pdecon = Deconstruct(Point=box_corners.CornerA)  # -> XComponent, YComponent, ZComponent
neg_4 = Negative(Value=pdecon.YComponent)
dom_3 = ConstructDomain(DomainStart=neg_4, DomainEnd=pdecon.YComponent)
planesrf = PlaneSurface(Plane=move_2.Geometry, XSize=dom_3, YSize=dom_3)
planesrf_2 = PlaneSurface(Plane=move.Geometry, XSize=dom_3, YSize=dom_3)
bbx = BrepBrep(BrepA=planesrf, BrepB=item_2)  # -> flatten(Curves), Points
bbx_2 = BrepBrep(BrepA=planesrf_2, BrepB=item_3)  # -> flatten(Curves), Points
crv = Curve([bbx_2.Curves, bbx.Curves])
loft = Loft(Curves=flatten(crv), Options={Adjust=True, Closed=False, LoftEnds=0, LoftSimp=0, LoftType=1, Rebuild=10, Refit=0.01})

# ----
# Trimmed wonky tori
item_4 = ListItem(List=planesrf, Index=-1, Wrap=True)
item_5 = ListItem(List=planesrf_2, Index=0, Wrap=True)
X_3 = UnitX(Factor=multiplication_3)
neg_5 = Negative(Value=X_3)
extr = Extrude(Base=item_5, Direction=neg_5)
extr_2 = Extrude(Base=item_4, Direction=X_3)
trim = TrimSolid(Shape=item_2, Cutters=extr_2)
trim_2 = TrimSolid(Shape=item_3, Cutters=extr)

L = ClusterOutput(loft)
join_2 = BrepJoin(Breps=flatten([trim, loft, trim_2]))  # -> Breps, Closed
geo = Geometry(join_2.Breps)
geo_2 = ClusterOutput(geo)

# ==== cluster Cluster
integer = Integer(500)
curve = ClusterInput()
range = Range(Domain=Domain(0, 1), Steps=integer)
evaluate_curve = EvaluateCurve(Curve=reparameterize(graft(curve)), Parameter=range)  # -> Point, Tangent, Angle
brep = ClusterInput()
brep_closest_point = BrepClosestPoint(Point=evaluate_curve.Point, Brep=brep)  # -> Point, Normal, Distance
interpolate = Interpolate(Vertices=brep_closest_point.Point, Degree=3, Periodic=False, KnotStyle=1)  # -> Curve, Length, Domain
curve_2 = ClusterOutput(interpolate.Curve)
